# Grasshopper definition image_reader.gh (Grasshopper 0.9.76)
# plug-ins: Firefly.X, Firefly.Core

buffer = Buffer(BufferDomain=Domain(0, 20))  # -> BufferValues, BufferMinimum, BufferMaximum
ports_available = COMPortsAvailable()
_50 = Number(50)
_0 = Number(0)
open_port = OpenClosePort(OpenClosePort=True, PortNumber=ports_available, BaudRate=115200)
pt = Point(Point(0, 0, 0))
timer = Timer(TimerInterval=200, Target=ports_available)  # disabled
X = UnitX(Factor=1)
txt = Text("D:\Dropbox\PROJECT\DIGITALNATIV\3D_MODELLING\Topo-03.jpg")
number_slider = Slider(5, range=0..10)
load_bitmap = LoadBitmap(FilePathToImageLocation=txt)
Y = UnitY(Factor=1)
arrlinear = LinearArray(Geometry=pt, Direction=X, Count=number_slider)  # -> Geometry, Transform
number_slider_2 = Slider(5, range=0..10)
decompose = BitmapDecompose(BitmapToDecompose=load_bitmap)  # -> RedChannel, GreenChannel, BlueChannel, AlphaChannel, XResolution, YResolution
arrlinear_2 = LinearArray(Geometry=arrlinear.Geometry, Direction=Y, Count=number_slider_2)  # -> Geometry, Transform
num = Number(40)
c_script = CSharpScript(img=txt, Rx=decompose.XResolution, Ry=decompose.YResolution, x=number_slider, y=number_slider_2)  # -> out, Z; inputs Rx: Int32, Ry: Int32, x: Int32, y: Int32
# ---------- c_script: C# ----------
    Bitmap image;
    image = new Bitmap(@"" + (string) img + "", true);
    DataTree<int> zz = new DataTree<int>();
    int dx = Rx / x;
    int dy = Ry / y;
    int xy = dx * dy;
    for(int i = 0;i < x;i++){
      GH_Path pth = new GH_Path(i);
      for(int j = 0;j < y;j++){
        long sum = 0;
        for(int k = (i * dx);k < (i + 1) * dx;k++){
          for(int l = (j * dy);l < (j + 1) * dy;l++){
            Color pixel = image.GetPixel(k, l);
            sum += Convert.ToInt64(pixel.R);
          }
        }
        zz.Add((int) (180 * (sum / xy) / 255.0), pth);
      }
    }
    Z = zz;
# ---------- end c_script ----------
c_script_2 = CSharpScript(x=_0, y=_50, z=c_script.Z)  # -> out, A; inputs x: Double, y: Double, z: tree
# ---------- c_script_2: C# ----------
    string zz = "|,";
    zz += x;
    zz += ",";
    zz += y;
    for(int i = 0;i < z.BranchCount;i++){
      for(int j = 0;j < z.Branch(0).Count;j++){
        zz += ",";
        zz += z.Branch(i)[j];

      }
    }
    zz += "/";
    A = zz;
# ---------- end c_script_2 ----------
write = SerialWriteGeneric(StartWritingValues=True, WriteData=c_script_2.A, PortNumber=ports_available)  # -> ArduinoOutput, StatusMessage
panel = Panel(write.ArduinoOutput)
division = Division(A=c_script.Z, B=num)
pdecon = Deconstruct(Point=arrlinear_2.Geometry)  # -> XComponent, YComponent, ZComponent
pt_2 = ConstructPoint(XCoordinate=pdecon.XComponent, YCoordinate=pdecon.YComponent, ZCoordinate=division)
ln = Line(StartPoint=arrlinear_2.Geometry, EndPoint=pt_2)
pipe = Pipe(Curve=ln, Radius=0.1, Caps=0)
