# Grasshopper definition physicalorientationawaresurface.gh (Grasshopper 0.9.76)
# plug-ins: gHowl, Firefly.Core

_50 = Number(25)
ports_available = COMPortsAvailable()
pt = Point(Point(0, 0, 0))
item = ListItem(List=ports_available, Index=2, Wrap=True)
X = UnitX(Factor=1)
timer = Timer(TimerInterval=50, Target=[ports_available, read, udp])  # disabled
open_port = OpenClosePort(OpenClosePort=False, PortNumber=item, BaudRate=115200)
read = SerialReadGeneric(StartReadingValues=True, PortNumber=item)  # -> SerialOutput, StatusMessage
udp = UDPReceiver(Address="10.0.1.12", Port=2000, Pattern=0)  # -> Info, Data
Y = UnitY(Factor=1)
arrlinear = LinearArray(Geometry=pt, Direction=X, Count=Slider(11, range=0..11))  # -> Geometry, Transform
panel = Panel(read.SerialOutput)
panel_2 = Panel(udp.Data)
arrlinear_2 = LinearArray(Geometry=arrlinear.Geometry, Direction=Y, Count=Slider(11, range=0..11))  # -> Geometry, Transform
pdecon = Deconstruct(Point=arrlinear_2.Geometry)  # -> XComponent, YComponent, ZComponent
c_script = CSharpScript(data=panel_2)  # -> out, xdeg, ydeg; inputs data: String
# ---------- c_script: C# ----------
    string[] dat = new String[6];
    dat = data.Split(default(string[]), StringSplitOptions.RemoveEmptyEntries);
    double yy;
    double xx;
    Double.TryParse(dat[4].Trim(','), out xx);
    xdeg = xx;
    Double.TryParse(dat[5], out yy);
    ydeg = yy;
# ---------- end c_script ----------
division = Division(A=c_script.ydeg, B=50)
division_2 = Division(A=c_script.xdeg, B=50)
c_script_2 = CSharpScript(x=pdecon.XComponent, y=pdecon.YComponent, xdeg=division_2, ydeg=division)  # -> out, A; inputs x: tree, y: tree, xdeg: Double, ydeg: Double
# ---------- c_script_2: C# ----------
    //declare tree
    DataTree<double> z = new DataTree<double>();
    //set up tree
    for(int i = 0; i < x.BranchCount;i++)
    {
      GH_Path pth = new GH_Path(i);
      for (int j = 0; j < x.Branch(0).Count;j++)
      {
        double xx,yy;
        if(xdeg > 0){
          xx = ((double) x.Branch(i)[j]) / 4;
        }
        else{
          xx = (-((double) x.Branch(i)[j]) + 10) / 4;
        }
        if(ydeg > 0){
          yy = ((double) y.Branch(i)[j])/4;
        }
        else{
          yy = (-((double) y.Branch(i)[j]) + 10)/4;
        }
        double zz = Math.Abs(xdeg) * (xx * xx) + Math.Abs(ydeg) * (yy * yy);
        z.Add(zz, pth);
      }
    }
    A = z;
# ---------- end c_script_2 ----------
c_script_3 = CSharpScript(x=_50, y=_50, z=c_script_2.A)  # -> out, A; inputs x: Double, y: Double, z: tree
# ---------- c_script_3: C# ----------
    string zz = "|,";
    zz += x;
    zz += ",";
    zz += y;
    for(int i = 0;i < z.BranchCount;i++){
      for(int j = 0;j < z.Branch(0).Count;j++){
        zz += ",";
        zz += Math.Round((double) z.Branch(i)[j] * 45);

      }
    }
    zz += "/";
    A = zz;
# ---------- end c_script_3 ----------
write = SerialWriteGeneric(StartWritingValues=True, WriteData=c_script_3.A)  # -> ArduinoOutput, StatusMessage
panel_3 = Panel(write.ArduinoOutput)
pt_2 = ConstructPoint(XCoordinate=pdecon.XComponent, YCoordinate=pdecon.YComponent, ZCoordinate=c_script_2.A)
ln = Line(StartPoint=arrlinear_2.Geometry, EndPoint=pt_2)
pipe = Pipe(Curve=ln, Radius=0.1, Caps=0)
