# Grasshopper definition sinusoidalcenter.gh (Grasshopper 0.9.76)
# plug-ins: Firefly.X, Firefly.Core

ports_available = COMPortsAvailable()
toggle = BooleanToggle(False)
_50 = Number(50)
multiplication = Multiplication(A=_50, B=2)
pt = Point(Point(2, 2, 0))
pt_2 = Point(Point(0, 0, 0))
open_port = OpenClosePort(OpenClosePort=False, PortNumber=ports_available, BaudRate=115200)
X = UnitX(Factor=1)
timer = Timer(TimerInterval=5, Target=[counter, ports_available, read])
read = SerialReadGeneric(StartReadingValues=True, PortNumber=ports_available)  # -> SerialOutput, StatusMessage
panel = Panel(read.SerialOutput)
counter = Counter(CountDirection=True, Step=1, StartStop=True, Reset=panel, OptionalCounterDomain=Domain(0, 1000))
division = Division(A=counter, B=_50)
Y = UnitY(Factor=1)
arrlinear = LinearArray(Geometry=pt_2, Direction=X, Count=Slider(5, range=0..11))  # -> Geometry, Transform
panel_2 = Panel(division)
vec2pt = Vector2Pt(PointA=pt_2, PointB=pt, Unitize=False)  # -> Vector, Length
arrlinear_2 = LinearArray(Geometry=arrlinear.Geometry, Direction=Y, Count=Slider(5, range=0..11))  # -> Geometry, Transform
vec2pt_2 = Vector2Pt(PointA=pt, PointB=arrlinear_2.Geometry, Unitize=False)  # -> Vector, Length
panel_3 = Panel(vec2pt_2.Length)
division_2 = Division(A=panel_3, B=vec2pt.Length)
panel_4 = Panel(division_2)
pdecon = Deconstruct(Point=arrlinear_2.Geometry)  # -> XComponent, YComponent, ZComponent
subtraction = Subtraction(A=panel_4, B=panel_2)
num = Number(2)
num_2 = Number(180)
multiplication_2 = Multiplication(A=num_2, B=subtraction)
sin = Sine(Value=degrees(multiplication_2))
panel_5 = Panel(sin)
multiplication_3 = Multiplication(A=panel_5, B=num)
addition = Addition(A=multiplication_3, B=num)
c_script = CSharpScript(x=counter, y=multiplication, z=addition)  # -> out, A; inputs x: Double, y: Double, z: tree
# ---------- c_script: C# ----------
    //List<double> zz = new List<double>();
    string zz = "|,";
    zz += x;
    zz += ",";
    zz += y;
    for(int i = 0;i < z.BranchCount;i++){
      for(int j = 0;j < z.Branch(0).Count;j++){
        zz += ",";
        zz += Math.Round((double) z.Branch(i)[j] * 45);

      }
    }
    zz += ",/";
    A = zz;
# ---------- end c_script ----------
write = SerialWriteGeneric(StartWritingValues=True, WriteData=c_script.A, PortNumber=ports_available)  # -> ArduinoOutput, StatusMessage
panel_6 = Panel(write.ArduinoOutput)
pt_3 = ConstructPoint(XCoordinate=pdecon.XComponent, YCoordinate=pdecon.YComponent, ZCoordinate=addition)
ln = Line(StartPoint=arrlinear_2.Geometry, EndPoint=pt_3)
pipe = Pipe(Curve=ln, Radius=0.1, Caps=0)
