# Grasshopper definition sinusoidalrotatecenter.gh (Grasshopper 0.9.76)
# plug-ins: Firefly.X, Firefly.Core

ports_available = COMPortsAvailable()
_50 = Number(25)
multiplication = Multiplication(A=_50, B=2)
toggle = BooleanToggle(False)
pt = Point(Point(0, 0, 0))
pt_2 = Point(Point(2, 2, 0))
X = UnitX(Factor=1)
timer = Timer(TimerInterval=25, Target=[counter, ports_available, read])
open_port = OpenClosePort(OpenClosePort=False, PortNumber=ports_available, BaudRate=115200)
read = SerialReadGeneric(StartReadingValues=True, PortNumber=ports_available)  # -> SerialOutput, StatusMessage
Y = UnitY(Factor=1)
arrlinear = LinearArray(Geometry=pt, Direction=X, Count=Slider(5, range=0..11))  # -> Geometry, Transform
panel = Panel(read.SerialOutput)
counter = Counter(CountDirection=True, Step=1, StartStop=True, Reset=panel, OptionalCounterDomain=Domain(0, 1000))
division = Division(A=counter, B=_50)
panel_2 = Panel(division)
vec2pt = Vector2Pt(PointA=pt, PointB=pt_2, Unitize=False)  # -> Vector, Length
arrlinear_2 = LinearArray(Geometry=arrlinear.Geometry, Direction=Y, Count=Slider(5, range=0..11))  # -> Geometry, Transform
vec2pt_2 = Vector2Pt(PointA=pt_2, PointB=arrlinear_2.Geometry, Unitize=False)  # -> Vector, Length
angle = Angle(VectorA=vec2pt_2.Vector, VectorB=vec2pt.Vector)  # -> Angle, Reflex
multiplication_2 = Multiplication(A=angle.Angle, B=2)
panel_3 = Panel(vec2pt_2.Length)
pi = Pi(Factor=panel_2)
pdecon = Deconstruct(Point=arrlinear_2.Geometry)  # -> XComponent, YComponent, ZComponent
num = Number(2)
subtraction = Subtraction(A=multiplication_2, B=pi)
sin = Sine(Value=subtraction)
panel_4 = Panel(sin)
multiplication_3 = Multiplication(A=panel_4, B=num)
addition = Addition(A=multiplication_3, B=num)
c_script = CSharpScript(x=counter, y=multiplication, z=addition)  # -> out, A; inputs x: Double, y: Double, z: tree
# ---------- c_script: C# ----------
    string zz = "|,";
    zz += x;
    zz += ",";
    zz += y;
    for(int i = 0;i < z.BranchCount;i++){
      for(int j = 0;j < z.Branch(0).Count;j++){
        zz += ",";
        zz += Math.Round((double) z.Branch(i)[j] * 45);

      }
    }
    zz += "/";
    A = zz;
# ---------- end c_script ----------
write = SerialWriteGeneric(StartWritingValues=True, WriteData=c_script.A, PortNumber=ports_available)  # -> ArduinoOutput, StatusMessage
panel_5 = Panel(write.ArduinoOutput)
pt_3 = ConstructPoint(XCoordinate=pdecon.XComponent, YCoordinate=pdecon.YComponent, ZCoordinate=addition)
ln = Line(StartPoint=arrlinear_2.Geometry, EndPoint=pt_3)
pipe = Pipe(Curve=ln, Radius=0.1, Caps=0)
